# Grasshopper definition udp-impor-rock-vision.gh (Grasshopper 1.0.8)
# plug-ins: Heteroptera, Pufferfish

trigger = Trigger(Interval=10, TimerInterval=10, Target=py3)
py3 = Python3Script(Run=Toggle(False), Port="5051")  # -> a, b, c, d, e, f, g; inputs Run: Boolean, Port: Int32
# ---------- py3: Python ----------
import socket
import json
import scriptcontext as sc
import Rhino.Geometry as rg

if 'sock' not in sc.sticky:
    sc.sticky['sock'] = None

if Run and sc.sticky['sock'] is None:
    try:
        sock = socket.socket(socket.AF_INET, socket.SOCK_DGRAM)
        sock.setsockopt(socket.SOL_SOCKET, socket.SO_REUSEADDR, 1)
        sock.bind(("192.168.1.178", Port))  # Asegúrate de que esta IP sea tu IP local
        sock.setblocking(False)
        sc.sticky['sock'] = sock
        status = "🟢 Listening on port {}".format(Port)
    except Exception as e:
        status = "❌ Error binding socket: {}".format(e)
        sc.sticky['sock'] = None

elif not Run and sc.sticky['sock'] is not None:
    try:
        sc.sticky['sock'].close()
    except:
        pass
    sc.sticky['sock'] = None
    status = "🛑 Socket closed."

# Salidas
positions, types, confidences, masses, radii, rectangles = [], [], [], [], [], []
sock = sc.sticky.get('sock')
if sock:
    try:
        msg, addr = sock.recvfrom(8192)
        decoded = json.loads(msg.decode())

        if isinstance(decoded, list):
            for item in decoded:
                # Posición normalizada como punto 3D
                x = float(item.get("x", 0))
                y = float(item.get("y", 0))
                positions.append(rg.Point3d(x, y, 0))

                # Otros datos
                types.append(str(item.get("type", "")))
                confidences.append(float(item.get("confidence", 0.0)))
                masses.append(float(item.get("mass", 0.0)))
                radii.append(float(item.get("radius", 0.0)))

                # Rectángulo como curva polilínea
                x1, y1, x2, y2 = item["rectangle"]
                pt1 = rg.Point3d(x1, y1, 0)
                pt2 = rg.Point3d(x2, y1, 0)
                pt3 = rg.Point3d(x2, y2, 0)
                pt4 = rg.Point3d(x1, y2, 0)
                poly = rg.Polyline([pt1, pt2, pt3, pt4, pt1])
                rectangles.append(rg.PolylineCurve(poly))

            status = "📨 Data received"

        else:
            status = "⚠️ Received non-list object"

    except socket.error:
        status = "⌛ Waiting for data..."
    except Exception as e:
        status = "❌ Decode error: {}".format(e)

# Salidas
a = positions
b = types
c = confidences
d = masses
e = radii
f = rectangles
g = status
# ---------- end py3 ----------
crv = Curve(py3.f)
explode = Explode(Curve=crv, Recursive=True)  # -> Segments, Vertices
item = ListItem(List=explode.Segments, Index=Slider(2, range=0..10), Wrap=True)
end = EndPoints(Curve=item)  # -> Start, End
item_2 = TreeItem(Index=0, Wrap=True)
rectangle = Rectangle(Plane=PlaneXY(0, 0, 0), XSize=Slider(637, range=0..1000), YSize=Slider(478, range=0..1000), Radius=0)  # -> Rectangle, Length
pt = Point(flatten(end.End))
panel = Panel("(,)")
roundd = RoundToDecimalPlace(NumberX=py3.d, DecimalPlace=2, RoundType=0)  # -> Rounded, Difference
roundd_2 = RoundToDecimalPlace(NumberX=py3.c, DecimalPlace=2, RoundType=0)  # -> Rounded, Difference
pt_2 = Point(py3.a)
panel_2 = Panel(py3.e)
panel_3 = Panel(py3.b)
panel_4 = Panel(py3.d)
concat = Concatenate(FragmentA=py3.b, FragmentB=roundd_2.Rounded, FragmentF=" confi", FragmentE=roundd.Rounded, FragmentG="kg")
textbake = TextBake(Location=pt, Text=concat, Size=Slider(11, range=0..100), Justification=6, Bake=False)
panel_5 = Panel(py3.c)
evalsrf = EvaluateSurface(Surface=reparameterize(rectangle.Rectangle), Point=pt_2)  # -> Point, Normal, UDirection, VDirection, Frame
multiplication = Multiplication(A=py3.e, B=Slider(15, range=0..1000))
cir = Circle(Plane=flatten(evalsrf.Point), Radius=multiplication)
offcrv = OffsetCurve(Curve=cir, Plane=PlaneXY(0, 0, 0), Distance=Slider(20, range=0..100), BothSides=0, Kinks=0, CapType=1)  # -> flatten(Offset); disabled
rulesrf = RuledSurface(CurveA=offcrv, CurveB=cir)  # disabled
pt_3 = Point(Point(0.5, 0.5, 0))  # disabled
number_slider = Slider(20, range=0..100)  # disabled
iso = IsoCurve(Surface=rulesrf, UVPoint=pt_3)  # -> UIsocurve, VIsocurve; disabled
crv_2 = Curve(flatten(iso.UIsocurve))  # disabled
textsrf = TextOnSurface(Text=concat, Font="Sans Bold:no Italic:no", Height=number_slider, Depth=0.4, BaseLine=crv_2, BaseSurface=rulesrf)  # disabled
